# Grasshopper definition 1.1 Extract and relocate beams.gh (Grasshopper 1.0.7)
# plug-ins: Speckle 2

# ----
# Import incoming elements (latest commit)
trondhack_raw_main = Panel("https://speckle.xyz/streams/4ddb373003")
receive = Receive(
    Stream=trondhack_raw_main,
    AutoReceive=True,
    CurrentComponentState="up_to_date",
    ExpandOutput=True,
    LastInfoMessage="Artur Tomczak @ 2022-05-14T10:33:34.036Z: Sent 737 objects from Revit2022. (id:af6bc25027)",
    ReceiveOnOpen=False,
    ReceivedCommitId="af6bc25027",
    StreamWrapper="https://speckle.xyz/streams/4ddb373003",
    selectedKitName="Objects")  # -> Info, Areas, CableTrays, Ceilings, Conduits, CurtainSystems, Doors, DuctSystems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

eso = ExpandSpeckleObject(SpeckleObject=flatten(receive.StructuralFraming), selectedKitName="Objects")  # -> BaseLine, Category, DisplayMesh, DisplayValue, ElementId, Family, Level, Parameters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
line = Line(eso.BaseLine)
mesh = Mesh(eso.DisplayMesh)

# ----
# Take only non-empty element's names
line_2 = Line(line)
txt = Text(eso.Type)
lng = ListLength(List=line_2)
equals = Equality(FirstNumber=lng, SecondNumber="0")  # -> Equality, Inequality
dispatch = Dispatch(List=txt, DispatchPattern=equals.Inequality)  # -> ListA, ListB
txt_2 = Text(flatten(dispatch.ListA))

mesh_2 = Mesh(flatten(mesh))

# ----
# Orient to XY
line_3 = Line(flatten(line))

end = EndPoints(Curve=line_3)  # -> Start, End

pl = PlaneNormal(Origin=end.Start, ZAxis=line_3)
orient = Orient(Geometry=mesh_2, Source=pl, Target=PlaneXY(0, 0, 0))  # -> Geometry, Transform
rotate = Rotate(Geometry=orient.Geometry, Angle=1.570796327, Plane=PlaneXY(0, 0, 0))  # -> Geometry, Transform
mesh_3 = Mesh(rotate.Geometry)

orient_2 = Orient(Geometry=line_3, Source=pl, Target=PlaneXY(0, 0, 0))  # -> Geometry, Transform

line_4 = Line(orient_2.Geometry)
mesh_4 = Mesh(mesh_3)
txt_3 = Text(flatten(txt_2))
len = Length(Curve=line_4)

# ----
# Distribute by area in Y direction
cutting_plane_mm = Panel("250")
pt = ConstructPoint(XCoordinate=0, YCoordinate=0, ZCoordinate=cutting_plane_mm)
pl_2 = PlaneNormal(Origin=pt, ZAxis=Vector(0, 0, 1))
sec = MeshPlane(Mesh=mesh_4, Plane=pl_2)
boundary = BoundarySurfaces(Edges=sec)  # -> flatten(Surfaces)
area = Area(Geometry=boundary)  # -> Area, Centroid
value = Number(area.Area)
dom = ConstructDomain(DomainStart="300", DomainEnd="3000")
dom_2 = ConstructDomain(DomainStart="0", DomainEnd="5000")
remap = RemapNumbers(Value=value, Source=dom, Target=dom_2)  # -> Mapped, Clipped
round = Round(Number=remap.Mapped)  # -> Nearest, Floor, Ceiling

# ----
# Distribute by length in X direction
value_2 = Number(len)
dom_3 = ConstructDomain(DomainStart="1500", DomainEnd="10000")
dom_4 = ConstructDomain(DomainStart="0", DomainEnd="5000")
remap_2 = RemapNumbers(Value=value_2, Source=dom_3, Target=dom_4)  # -> Mapped, Clipped
round_2 = Round(Number=remap_2.Mapped)  # -> Nearest, Floor, Ceiling

# ----
# Assign random color
ma = MassAddition(Input=len)  # -> Result, PartialResults
dom_5 = ConstructDomain(DomainStart="0", DomainEnd="255")
division = Division(A=ma.Result, B=12)
random = Random(Range=dom_5, Number=1, Seed=division)
random_2 = Random(Range=dom_5, Number=1, Seed=ma.Result)
rgb = ColourRGB(Alpha="125", Red=random_2, Green=random, Blue=0)
rendermaterial = RenderMaterial(
    Opacity="0.2",
    Metalness=0,
    Roughness=1,
    Diffuse=rgb,
    SelectedConstructorName="Objects.Other.RenderMaterial.ctor(System.Double,System.Double,System.Double,System.Nullable`1[System.Drawing.Color],System.Nullable`1[System.Drawing.Color])",
    SelectedTypeName="Objects.Other.RenderMaterial",
    UseSchemaTag=False,
    UserSetSchemaTag=False,
    seed="751f623aa418e7b99513")

Y = UnitY(Factor=round.Nearest)
X = UnitX(Factor=round_2.Nearest)
line_5 = Line(line_4)
mesh_5 = Mesh(mesh_4)
addition = Addition(A=X, B=Y)
move = Move(Geometry=mesh_5, Motion=addition)  # -> Geometry, Transform
move_2 = Move(Geometry=line_5, Motion=addition)  # -> Geometry, Transform
line_6 = Line(move_2.Geometry)
mesh_6 = Mesh(move.Geometry)

# ----
# Create Speckle objects
line_7 = Line(line_6)
txt_4 = Text(txt_3)
mesh_7 = Mesh(mesh_6)
value_3 = Number(round.Nearest)
to_speckle = ToSpeckle(Data=mesh_7, selectedKitName="Objects")
eso_2 = ExtendSpeckleObject(
    SpeckleObject=to_speckle,
    RenderMaterial=rendermaterial,
    LocationLine=line_7,
    TypeName=txt_4,
    Area=value_3,
    selectedKitName="Objects")

# ----
# Send to preprocessing branch
trondhack_preprocessed_main = Panel("https://speckle.xyz/streams/adda68dad6")
ss = SynchronousSender(
    Data=eso_2,
    Stream=trondhack_preprocessed_main,
    KitName="Objects",
    OutputWrappers="https://speckle.xyz\tadda68dad6\t159b484cb3",
    UseDefaultCache=True)
