# Grasshopper definition 2.1 Read and map elements from MB.gh (Grasshopper 1.0.7)
# plug-ins: Speckle 2

# ----
# Import current Material Bank elements (latest commit)
panel = Panel("https://speckle.xyz/streams/c9c12bb7c7/commits/909df82e63")
temp_collection = Panel("https://speckle.xyz/streams/c4c6aed0b8/commits/f1696e067b")
receive = Receive(
    Stream=temp_collection,
    AutoReceive=False,
    CurrentComponentState="up_to_date",
    ExpandOutput=True,
    LastInfoMessage="Artur Tomczak @ 2022-05-12T18:22:20.893Z: Pushed 173 elements from Grasshopper. (id:f1696e067b)",
    ReceiveOnOpen=False,
    ReceivedCommitId="f1696e067b",
    StreamWrapper="https://speckle.xyz/streams/c4c6aed0b8/commits/f1696e067b",
    selectedKitName="None")  # -> Info, Data

expand_speckle_object = ExpandSpeckleObject(SpeckleObject=receive.Data, selectedKitName="Objects")  # -> Area, Bbox, Colors, Faces, Height, LocationLine, RenderMaterial, TextureCoordinates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
